# Grasshopper definition case.gh (Grasshopper 1.0.8)

case_outline = Curve(<curve referenced from the Rhino model>)
switches_outline = Curve([<curve referenced from the Rhino model> x21])
switches_courtyard = Curve([<curve referenced from the Rhino model> x2])
fillet = FilletDistance(Curve=case_outline, Distance=Slider(1, range=0..1))
Z = UnitZ(Factor=Slider(1.6, range=0..10))
Z_2 = UnitZ(Factor=Slider(10, range=0..100))
boundary = BoundarySurfaces(Edges=switches_outline)
pcb_outline = Curve(<curve referenced from the Rhino model>)
mcu_outline = Curve(<curve referenced from the Rhino model>)
move = Move(Geometry=case_outline, Motion=Z)  # -> Geometry, Transform
extr = Extrude(Base=boundary, Direction=Z_2)
boundary_2 = BoundarySurfaces(Edges=move.Geometry)
fillet_2 = FilletDistance(Curve=switches_courtyard, Distance=Slider(1, range=0..1))
Z_3 = UnitZ(Factor=Slider(10, range=0..10))
Z_4 = UnitZ(Factor=Slider(7, range=0..10))
addition = Addition(A=Slider(1.6, range=0..10), B=Slider(2.2, range=0..10))
offset = OffsetCurve(Curve=mcu_outline, Distance=Slider(0.1, range=0..1), Corners=1)
Z_5 = UnitZ(Factor=addition)
fillet_3 = FilletDistance(Curve=pcb_outline, Distance=Slider(1, range=0..1))
boundary_3 = BoundarySurfaces(Edges=fillet_2)
extr_2 = Extrude(Base=boundary_2, Direction=Z_4)
number_slider = Slider(3, range=0..10)
move_2 = Move(Geometry=boundary_3, Motion=Z_5)  # -> Geometry, Transform
offset_2 = OffsetCurve(Curve=fillet_3, Distance=Slider(0.1, range=0..1), Corners=1)
extr_3 = Extrude(Base=move_2.Geometry, Direction=Z_3)
Z_6 = UnitZ(Factor=number_slider)
rdiff = RegionDifference(CurvesA=case_outline, CurvesB=offset_2)
rdiff_2 = RegionDifference(CurvesA=fillet_3, CurvesB=flatten([offset, switches_outline]))
rdiff_3 = RegionDifference(CurvesA=fillet_3, CurvesB=flatten(offset))
sdiff = SolidDifference(BrepsA=extr_2, BrepsB=extr_3)
Z_7 = UnitZ(Factor=Slider(3, range=0..10))
neg = Negative(Value=Z_6)
number_slider_2 = Slider(1.6, range=0..10)
boundary_4 = BoundarySurfaces(Edges=rdiff_2)
boundary_5 = BoundarySurfaces(Edges=rdiff_3)
neg_2 = Negative(Value=Z_7)
sdiff_2 = SolidDifference(BrepsA=sdiff, BrepsB=extr)
Z_8 = UnitZ(Factor=number_slider_2)
move_3 = Move(Geometry=rdiff, Motion=neg)  # -> Geometry, Transform
boundary_6 = BoundarySurfaces(Edges=move_3.Geometry)
addition_2 = Addition(A=number_slider, B=number_slider_2)
extr_4 = Extrude(Base=boundary_5, Direction=neg_2)
extr_5 = Extrude(Base=boundary_4, Direction=Z_8)
Z_9 = UnitZ(Factor=addition_2)
extr_6 = Extrude(Base=boundary_6, Direction=Z_9)
crv = Curve(<curve referenced from the Rhino model>)
crv_2 = Curve([<curve referenced from the Rhino model> x21])
crv_3 = Curve(<curve referenced from the Rhino model>)
crv_4 = Curve(<curve referenced from the Rhino model>)
crv_5 = Curve([<curve referenced from the Rhino model> x21])
crv_6 = Curve([<curve referenced from the Rhino model> x2])
crv_7 = Curve([<curve referenced from the Rhino model> x21])
rdiff_4 = RegionDifference(CurvesA=crv, CurvesB=crv_2)
runion = RegionUnion(Curves=crv_6)
crv_8 = Curve([<curve referenced from the Rhino model> x21])
crv_9 = Curve(<curve referenced from the Rhino model>)
crv_10 = Curve(<curve referenced from the Rhino model>)
boundary_7 = BoundarySurfaces(Edges=rdiff_4)
runion_2 = RegionUnion(Curves=crv_3)
crv_11 = Curve(<curve referenced from the Rhino model>)
rdiff_5 = RegionDifference(CurvesA=crv_4, CurvesB=crv_3)
crv_12 = Curve(<curve referenced from the Rhino model>)
number_slider_3 = Slider(1.6, range=0..10)
rdiff_6 = RegionDifference(CurvesA=rdiff_5, CurvesB=crv_5)
number_slider_4 = Slider(10, range=0..10)
Z_10 = UnitZ(Factor=Slider(10, range=0..10))
boundary_8 = BoundarySurfaces(Edges=crv_7)
rdiff_7 = RegionDifference(CurvesA=runion, CurvesB=crv_8)
boundary_9 = BoundarySurfaces(Edges=crv_10)
neg_3 = Negative(Value=Z_10)
boundary_10 = BoundarySurfaces(Edges=crv_11)
boundary_11 = BoundarySurfaces(Edges=crv_12)
move_4 = Move(Geometry=crv_5, Motion=neg_3)  # -> Geometry, Transform
boundary_12 = BoundarySurfaces(Edges=rdiff_6)
number_slider_5 = Slider(2.2, range=0..10)
Z_11 = UnitZ(Factor=Slider(1.6, range=0..10))
Z_12 = UnitZ(Factor=Slider(20, range=0..100))
number_slider_6 = Slider(2, range=0..10)
Z_13 = UnitZ(Factor=number_slider_3)
Z_14 = UnitZ(Factor=Slider(1.6, range=0..10))
boundary_13 = BoundarySurfaces(Edges=crv_9)
Z_15 = UnitZ(Factor=Slider(1.6, range=0..10))
extr_7 = Extrude(Base=boundary_12, Direction=Z_11)
extr_8 = Extrude(Base=move_4.Geometry, Direction=Z_12)
addition_3 = Addition(A=number_slider_5, B=Slider(3.1, range=0..10))
boundary_14 = BoundarySurfaces(Edges=rdiff_7)
number_slider_7 = Slider(6.4, range=0..10)
Z_16 = UnitZ(Factor=addition_3)
move_5 = Move(Geometry=boundary_9, Motion=Z_13)  # -> Geometry, Transform
move_6 = Move(Geometry=boundary_7, Motion=Z_14)  # -> Geometry, Transform
move_7 = Move(Geometry=boundary_11, Motion=Z_15)  # -> Geometry, Transform
Z_17 = UnitZ(Factor=Slider(8.5, range=0..10))
addition_4 = Addition(A=number_slider_3, B=number_slider_6)
Z_18 = UnitZ(Factor=number_slider_5)
neg_4 = Negative(Value=number_slider_6)
cap = CapHoles(Brep=extr_8)
Z_19 = UnitZ(Factor=neg_4)
extr_9 = Extrude(Base=boundary_13, Direction=Z_16)
brep = Brep(<brep referenced from the Rhino model>)
move_8 = Move(Geometry=crv_6, Motion=Z_16)  # -> Geometry, Transform
Z_20 = UnitZ(Factor=number_slider_7)
Z_21 = UnitZ(Factor=Slider(2.2, range=0..10))
extr_10 = Extrude(Base=boundary_8, Direction=Z_17)
move_9 = Move(Geometry=crv_6, Motion=Z_18)  # -> Geometry, Transform
sdiff_3 = SolidDifference(BrepsA=brep, BrepsB=cap)
extr_11 = Extrude(Base=boundary_14, Direction=Z_18)
move_10 = Move(Geometry=boundary_10, Motion=Z_19)  # -> Geometry, Transform
extr_12 = Extrude(Base=move_6.Geometry, Direction=Z_21)
addition_5 = Addition(A=addition_4, B=number_slider_7)

# ---- group: BOTTOM
crv_13 = Curve(<curve referenced from the Rhino model>)
boundary_15 = BoundarySurfaces(Edges=crv_13)
Z_22 = UnitZ(Factor=Slider(3, range=0..10))
extr_13 = Extrude(Base=boundary_15, Direction=Z_22)
cap_2 = CapHoles(Brep=extr_13)

# ----
crv_14 = Curve(<curve referenced from the Rhino model>)
Z_23 = UnitZ(Factor=Slider(7, range=0..10))
extr_14 = Extrude(Base=move_5.Geometry, Direction=Z_20)
extr_15 = Extrude(Base=move_7.Geometry, Direction=Z_23)
addition_6 = Addition(A=addition_5, B=Slider(1.5, range=0..10))
boundary_16 = BoundarySurfaces(Edges=crv_14)
sunion = SolidUnion(Breps=[extr_7, extr_12])
Z_24 = UnitZ(Factor=addition_6)
Z_25 = UnitZ(Factor=Slider(7, range=0..10))
extr_16 = Extrude(Base=move_10.Geometry, Direction=Z_24)
extr_17 = Extrude(Base=boundary_16, Direction=Z_25)
cap_3 = CapHoles(Brep=extr_17)
offset_3 = OffsetSurface(Distance=Slider(5.1, range=0..10), Retrim=True)
brep_2 = Brep(<brep referenced from the Rhino model>)
cap_4 = CapHoles(Brep=brep_2)
