# Grasshopper definition nii-thumb2.gh (Grasshopper 1.0.8)

number_slider = Slider(1.85, range=0..10)
num = Number(number_slider)
series = Series(Start=0, Step=num, Count=Slider(3, range=0..10))
series_2 = Series(Start=0, Step=num, Count=Slider(6, range=0..10))
pt = ConstructPoint(XCoordinate=0, YCoordinate=series, ZCoordinate=0)
panel = Panel("column")
X = UnitX(Factor=series_2)
move = Move(Geometry=pt, Motion=graft(X))  # -> simplify(Geometry), Transform

# ---- group: stagger
outer = Slider(0, range=-3..3)
middle = Slider(1.5, range=-3..3)
ring = Slider(1.2, range=-3..3)
inner = Slider(0, range=-3..3)
pinky = Slider(0, range=-3..3)
index = Slider(0, range=-3..3)

# ----
Y = UnitY(Factor=graft([inner, index, middle, ring, pinky, outer]))
move_2 = Move(Geometry=move.Geometry, Motion=Y)  # -> Geometry, Transform
rad = Radians(Degrees=Slider(90, range=0..100))

# ---- group: shift
middle_2 = Slider(-0.05, range=-1..1)
ring_2 = Slider(-0.1, range=-1..1)
pinky_2 = Slider(-0.15, range=-1..1)
outer_2 = Slider(-0.15, range=-1..1)
inner_2 = Slider(0, range=-1..1)
index_2 = Slider(0, range=-1..1)

# ----
pt_2 = Point(move_2.Geometry)
X_2 = UnitX(Factor=graft([inner_2, index_2, middle_2, ring_2, pinky_2, outer_2]))
move_3 = Move(Geometry=pt_2, Motion=X_2)  # -> Geometry, Transform
rad_2 = Radians(Degrees=Slider(9, range=0..100))
pt_3 = Point(move_3.Geometry)
num_2 = Number(number_slider)
number_slider_2 = Slider(0, range=-30..30)
number_slider_3 = Slider(-3, range=-30..30)

# ---- group: splay
number_slider_4 = Slider(-3, range=-30..30)

# ----
number_slider_5 = Slider(3, range=-30..30)
number_slider_6 = Slider(6, range=-30..30)
number_slider_7 = Slider(6, range=-30..30)
number_slider_8 = Slider(1.7, range=0..10)
dom = ConstructDomain(DomainStart=expr("-x/2", num_2), DomainEnd=expr("x/2", num_2))
pt_4 = Point(pt_3)
panel_2 = Panel(dom)
item = ListItem(List=flatten(pt_4), Index=0, Wrap=True)
rectangle = Rectangle(Plane=pt_4, XSize=dom, YSize=dom, Radius=0)  # -> Rectangle, Length
num_3 = Number([number_slider_4, number_slider_3, number_slider_2, number_slider_5, number_slider_6, number_slider_7])
rad_3 = Radians(Degrees=graft([number_slider_4, number_slider_3, number_slider_2, number_slider_5, number_slider_6, number_slider_7]))  # -> expr("-x", Radians)
rotate = Rotate(Geometry=rectangle.Rectangle, Angle=rad_3, Plane=item)  # -> Geometry, Transform
flip = FlipMatrix(Data=rotate.Geometry)
item_2 = ListItem(List=flip, Index=0, Wrap=True)  # -> flatten(Item)
item_3 = ListItem(List=item_2, Index=0, Wrap=True)
pcen = PolygonCenter(Polyline=item_2)  # -> CenterV, CenterE, CenterA
rotate_2 = Rotate(Geometry=item_2, Angle=rad, Plane=item_3)  # -> Geometry, Transform
item_4 = ListItem(List=pcen.CenterV, Index=1, Wrap=True)
item_5 = ListItem(List=pcen.CenterV, Index=0, Wrap=True)
vec2pt = Vector2Pt(PointA=item_4, PointB=item_5, Unitize=False)  # -> Vector, Length
amp = Amplitude(Vector=vec2pt.Vector, Amplitude=Slider(2.858, range=0..10))
rotate_3 = Rotate(Geometry=rotate_2.Geometry, Angle=rad_2, Plane=item_3)  # -> Geometry, Transform
move_4 = Move(Geometry=rotate_3.Geometry, Motion=amp)  # -> Geometry, Transform
pcen_2 = PolygonCenter(Polyline=move_4.Geometry)  # -> CenterV, CenterE, CenterA
item_6 = ListItem(List=pcen_2.CenterV, Index=1, Wrap=True)
item_7 = ListItem(List=pcen_2.CenterV, Index=0, Wrap=True)
vec2pt_2 = Vector2Pt(PointA=item_6, PointB=item_7, Unitize=False)  # -> Vector, Length
amp_2 = Amplitude(Vector=vec2pt_2.Vector, Amplitude=Slider(1.12, range=0..10))
move_5 = Move(Geometry=move_4.Geometry, Motion=amp_2)  # -> Geometry, Transform
number_slider_9 = Slider(1.85, range=0..10)

item_8 = ListItem(List=move_5.Geometry, Index=0, Wrap=True)
explode = Explode(Curve=item_8, Recursive=True)  # -> Segments, Vertices
item_9 = ListItem(List=explode.Vertices, Index=0, Wrap=True)
item_10 = ListItem(List=explode.Vertices, Index=1, Wrap=True)
item_11 = ListItem(List=explode.Vertices, Index=3, Wrap=True)
pl_3pt = Plane3Pt(PointA=item_9, PointB=item_11, PointC=item_10)
deplane = DeconstructPlane(Plane=pl_3pt)  # -> Origin, XAxis, YAxis, ZAxis
amp_3 = Amplitude(Vector=deplane.XAxis, Amplitude=number_slider_9)
neg = Negative(Value=Slider(1.83, range=0..10))
move_6 = Move(Geometry=pl_3pt, Motion=amp_3)  # -> Geometry, Transform
rad_4 = Radians(Degrees=Slider(0, range=0..10))
neg_2 = Negative(Value=rad_4)
prot = RotatePlane(Plane=move_6.Geometry, Angle=neg_2)
orient = Orient(Geometry=item_8, Source=pl_3pt, Target=prot)  # -> Geometry, Transform
deplane_2 = DeconstructPlane(Plane=prot)  # -> Origin, XAxis, YAxis, ZAxis
amp_4 = Amplitude(Vector=deplane_2.XAxis, Amplitude=number_slider_9)
neg_3 = Negative(Value=Slider(1.85, range=0..10))
move_7 = Move(Geometry=prot, Motion=amp_4)  # -> Geometry, Transform
rad_5 = Radians(Degrees=Slider(0, range=0..10))
neg_4 = Negative(Value=rad_5)
prot_2 = RotatePlane(Plane=move_7.Geometry, Angle=neg_4)
orient_2 = Orient(Geometry=orient.Geometry, Source=prot, Target=prot_2)  # -> Geometry, Transform
merge = Merge(Data1=item_8, Data2=orient.Geometry, Data3=orient_2.Geometry)

crv = Curve(merge)
merge_2 = Merge(Data1=rotate.Geometry, Data2=crv)
rotate_4 = Rotate(Geometry=merge_2, Angle=degrees(Slider(-3, range=-10..21)), Plane=PlaneXY(0, 0, 0))  # -> Geometry, Transform
scale = Scale(Geometry=rotate_4.Geometry, Center=Point(0, 0, 0), Factor=Slider(10, range=0..10))  # -> Geometry, Transform
containter = Curve(scale.Geometry)
offset = OffsetCurve(Curve=containter, Distance=Slider(1, range=0..1), Plane=PlaneXY(0, 0, 0), Corners=1)
neg_5 = Negative(Value=Slider(2.25, range=0..10))
neg_6 = Negative(Value=Slider(0.25, range=0..10))
crv_2 = Curve(<curve referenced from the Rhino model>)
offset_2 = OffsetCurve(Curve=containter, Distance=neg_5, Plane=PlaneXY(0, 0, 0), Corners=1)  # -> flatten(Curve)
runion = RegionUnion(Curves=flatten(offset))
offset_3 = OffsetCurve(Curve=containter, Distance=neg_6, Plane=PlaneXY(0, 0, 0), Corners=1)
crv_3 = Curve(flatten(offset_3))
crv_4 = Curve(flatten(offset_2))
explode_2 = Explode(Curve=offset_2, Recursive=True)  # -> Segments, Vertices
len = Length(Curve=explode_2.Segments)
fillet = Fillet(Curve=crv_3, Radius=Slider(1, range=0..1))
offset_4 = OffsetCurve(Curve=runion, Distance=Slider(1, range=0..1), Plane=PlaneXY(0, 0, 0), Corners=1)
explode_3 = Explode(Curve=crv_3, Recursive=True)  # -> Segments, Vertices
len_2 = Length(Curve=explode_3.Segments)
panel_3 = Panel(len_2)
fillet_2 = Fillet(Curve=crv_2, Radius=Slider(1, range=0..10))
offset_5 = OffsetCurve(Curve=crv_2, Distance=1, Corners=1)
panel_4 = Panel(len)
neg_7 = Negative(Value=Slider(2, range=0..10))
offset_6 = OffsetCurve(Curve=offset_4, Distance=neg_7, Plane=PlaneXY(0, 0, 0), Corners=1)
fillet_3 = Fillet(Curve=offset_5, Radius=Slider(2, range=0..10))
mcu = Curve([<curve referenced from the Rhino model> x2])
outline = Curve(<curve referenced from the Rhino model>)
offset_7 = OffsetCurve(Curve=offset_6, Distance=Slider(0.75, range=0..10), Plane=PlaneXY(0, 0, 0), Corners=1)
runion_2 = RegionUnion(Curves=mcu)
fillet_4 = Fillet(Curve=outline, Radius=Slider(2, range=0..10))
offset_8 = OffsetCurve(Curve=runion_2, Distance=Slider(0.1, range=0..1), Corners=1)
item_12 = ListItem(List=mcu, Index=1, Wrap=True)
rdiff = RegionDifference(CurvesA=fillet_4, CurvesB=offset_8)
pcb_outline = Curve(rdiff)
pcen_3 = PolygonCenter(Polyline=[item_12, offset_2])  # -> CenterV, CenterE, CenterA
Z = UnitZ(Factor=Slider(5, range=0..10))
boundary = BoundarySurfaces(Edges=offset_2)
boundary_2 = BoundarySurfaces(Edges=pcb_outline)
Z_2 = UnitZ(Factor=Slider(1.5, range=0..10))
extr = Extrude(Base=boundary, Direction=Z)
extr_2 = Extrude(Base=boundary_2, Direction=Z_2)
cir = Circle(Plane=pcen_3.CenterV, Radius=Slider(5, range=0..10))
sdiff = SolidDifference(BrepsA=extr_2, BrepsB=extr)
merge_3 = Merge(Data1=sdiff)

hframe = HorizontalFrame(Curve=reparameterize(offset_2), Parameter=graft(Slider(0.8, range=0..1)))
hframe_2 = HorizontalFrame(Curve=reparameterize(offset_2), Parameter=graft(Slider(0.45, range=0..1)))
deplane_3 = DeconstructPlane(Plane=hframe)  # -> Origin, XAxis, YAxis, ZAxis
deplane_4 = DeconstructPlane(Plane=hframe_2)  # -> Origin, XAxis, YAxis, ZAxis
neg_8 = Negative(Value=Slider(0, range=0..10))
neg_9 = Negative(Value=Slider(0, range=0..10))
amp_5 = Amplitude(Vector=deplane_3.YAxis, Amplitude=neg_8)
amp_6 = Amplitude(Vector=deplane_4.YAxis, Amplitude=neg_9)
neg_10 = Negative(Value=amp_5)
neg_11 = Negative(Value=amp_6)
move_8 = Move(Geometry=deplane_3.Origin, Motion=neg_10)  # -> Geometry, Transform
move_9 = Move(Geometry=deplane_4.Origin, Motion=neg_11)  # -> Geometry, Transform
cullpt = CullDuplicates(Points=flatten(move_8.Geometry), Tolerance=0.1, CullMode=3)  # -> Points, Indices, Valence
cullpt_2 = CullDuplicates(Points=flatten(move_9.Geometry), Tolerance=0.1, CullMode=3)  # -> Points, Indices, Valence
cir_2 = Circle(Plane=cullpt.Points, Radius=Slider(2.25, range=0..10))
cir_3 = Circle(Plane=cullpt_2.Points, Radius=Slider(2.25, range=0..10))

# ---- group: PEREMICHKA
crv_5 = Curve(outline)
explode_4 = Explode(Curve=crv_5, Recursive=True)  # -> Segments, Vertices
item_13 = ListItem(List=explode_4.Segments, Index=Slider(2, range=0..10), Wrap=True)
number_slider_10 = Slider(15, range=0..100)
hframe_3 = HorizontalFrame(Curve=reparameterize(item_13), Parameter=Slider(0.5, range=0..1))
dom_2 = ConstructDomain(DomainStart=expr("-x", number_slider_10), DomainEnd=number_slider_10)
dom_3 = ConstructDomain(DomainStart=expr("-x", 0), DomainEnd=Slider(45, range=0..100))
rectangle_2 = Rectangle(Plane=hframe_3, XSize=dom_2, YSize=dom_3, Radius=0)  # -> Rectangle, Length
explode_5 = Explode(Curve=rectangle_2.Rectangle, Recursive=True)  # -> Segments, Vertices
item_14 = ListItem(List=explode_5.Segments, Index=[2, 0], Wrap=True)
number_slider_11 = Slider(3, range=0..10)
number_slider_12 = Slider(6, range=0..10)
eval = EvaluateCurve(Curve=reparameterize(item_14), Parameter=Slider(0.5, range=0..1))  # -> Point, Tangent, Angle
dom_4 = ConstructDomain(DomainStart=expr("-x", number_slider_12), DomainEnd=number_slider_12)
dom_5 = ConstructDomain(DomainStart=expr("-x", number_slider_11), DomainEnd=number_slider_11)
rectangle_3 = Rectangle(Plane=eval.Point, XSize=dom_5, YSize=dom_4, Radius=0)  # -> Rectangle, Length
fillet_5 = Fillet(Curve=rectangle_3.Rectangle, Radius=number_slider_11)
cir_4 = Circle(Plane=explode_5.Vertices, Radius=number_slider_11)
rdiff_2 = RegionDifference(CurvesA=rectangle_2.Rectangle, CurvesB=[cir_4, fillet_5])
number_slider_13 = Slider(5, range=0..10)
number_slider_14 = Slider(13, range=0..20)
number_slider_15 = Slider(9, range=0..10)
number_slider_16 = Slider(1, range=0..10)
explode_6 = Explode(Curve=rdiff_2, Recursive=True)  # -> Segments, Vertices
cull_i = CullIndex(List=explode_6.Segments, Indices=[number_slider_16, number_slider_13, number_slider_15, number_slider_14], Wrap=True)
item_15 = ListItem(List=explode_6.Segments, Index=[number_slider_16, number_slider_13, number_slider_15, number_slider_14], Wrap=True)
join = JoinCurves(Curves=cull_i, Preserve=False)
fillet_6 = Fillet(Curve=join, Radius=Slider(1, range=0..10))
join_2 = JoinCurves(Curves=flatten([item_15, fillet_6]), Preserve=False)

# ----
item_16 = ListItem(List=offset_2, Index=Slider(18, range=0..100), Wrap=True)
explode_7 = Explode(Curve=item_16, Recursive=True)  # -> Segments, Vertices
item_17 = ListItem(List=explode_7.Segments, Index=Slider(1, range=0..100), Wrap=True)
neg_12 = Negative(Value=Slider(7.5, range=0..10))
hframe_4 = HorizontalFrame(Curve=item_17, Parameter=Slider(0, range=0..1))
deplane_5 = DeconstructPlane(Plane=hframe_4)  # -> Origin, XAxis, YAxis, ZAxis
amp_7 = Amplitude(Vector=deplane_5.XAxis, Amplitude=neg_12)
move_10 = Move(Geometry=deplane_5.Origin, Motion=amp_7)  # -> Geometry, Transform
amp_8 = Amplitude(Vector=deplane_5.YAxis, Amplitude=Slider(0.2, range=0..10))
move_11 = Move(Geometry=move_10.Geometry, Motion=amp_8)  # -> Geometry, Transform
cir_5 = Circle(Plane=move_11.Geometry, Radius=Slider(2, range=0..10))

merge_4 = Merge(Data1=cir_5, Data2=cir_2, Data3=cir)
merge_5 = Merge(Data1=cir_5, Data2=cir_3, Data3=cir)
X_3 = UnitX(Factor=expr("-x", Slider(65, range=0..100)))
mirror = Mirror(Geometry=merge_5, Plane=PlaneYZ(0, 0, 0))  # -> Geometry, Transform
move_12 = Move(Geometry=mirror.Geometry, Motion=X_3)  # -> Geometry, Transform
merge_6 = Merge(Data1=merge_4, Data2=move_12.Geometry)
cutout_contour = Curve(pcb_outline)
X_4 = UnitX(Factor=expr("-x", Slider(65, range=0..100)))
mirror_2 = Mirror(Geometry=cutout_contour, Plane=PlaneYZ(0, 0, 0))  # -> Geometry, Transform
move_13 = Move(Geometry=mirror_2.Geometry, Motion=X_4)  # -> Geometry, Transform
merge_7 = Merge(Data1=cutout_contour, Data2=move_13.Geometry)
runion_3 = RegionUnion(Curves=flatten([merge_7, join_2]))
merge_8 = Merge(Data1=runion_3)
