# Grasshopper definition nii-v2.gh (Grasshopper 1.0.8)

number_slider = Slider(1.85, range=0..10)
num = Number(number_slider)
series = Series(Start=0, Step=num, Count=Slider(3, range=0..10))
series_2 = Series(Start=0, Step=num, Count=Slider(6, range=0..10))
pt = ConstructPoint(XCoordinate=0, YCoordinate=series, ZCoordinate=0)
panel = Panel("column")
X = UnitX(Factor=series_2)
move = Move(Geometry=pt, Motion=graft(X))  # -> simplify(Geometry), Transform

# ---- group: stagger
middle = Slider(1.5, range=-3..3)
outer = Slider(0, range=-3..3)
ring = Slider(1.2, range=-3..3)
pinky = Slider(0, range=-3..3)
inner = Slider(0, range=-3..3)
index = Slider(0, range=-3..3)

# ----
Y = UnitY(Factor=graft([inner, index, middle, ring, pinky, outer]))
move_2 = Move(Geometry=move.Geometry, Motion=Y)  # -> Geometry, Transform

# ---- group: shift
ring_2 = Slider(-0.1, range=-1..1)
middle_2 = Slider(-0.05, range=-1..1)
pinky_2 = Slider(-0.15, range=-1..1)
outer_2 = Slider(-0.15, range=-1..1)
inner_2 = Slider(0, range=-1..1)
index_2 = Slider(0, range=-1..1)

# ----
pt_2 = Point(move_2.Geometry)
X_2 = UnitX(Factor=graft([inner_2, index_2, middle_2, ring_2, pinky_2, outer_2]))
move_3 = Move(Geometry=pt_2, Motion=X_2)  # -> Geometry, Transform
pt_3 = Point(move_3.Geometry)
num_2 = Number(number_slider)
number_slider_2 = Slider(0, range=-30..30)

# ---- group: splay
number_slider_3 = Slider(-3, range=-30..30)

# ----
number_slider_4 = Slider(-3, range=-30..30)
number_slider_5 = Slider(3, range=-30..30)
number_slider_6 = Slider(6, range=-30..30)
number_slider_7 = Slider(6, range=-30..30)
dom = ConstructDomain(DomainStart=expr("-x/2", num_2), DomainEnd=expr("x/2", num_2))
pt_4 = Point(pt_3)
panel_2 = Panel(dom)
item = ListItem(List=flatten(pt_4), Index=0, Wrap=True)
rectangle = Rectangle(Plane=pt_4, XSize=dom, YSize=dom, Radius=0)  # -> Rectangle, Length
num_3 = Number([number_slider_3, number_slider_4, number_slider_2, number_slider_5, number_slider_6, number_slider_7])
rad = Radians(Degrees=graft([number_slider_3, number_slider_4, number_slider_2, number_slider_5, number_slider_6, number_slider_7]))  # -> expr("-x", Radians)
rotate = Rotate(Geometry=rectangle.Rectangle, Angle=rad, Plane=item)  # -> Geometry, Transform
flip = FlipMatrix(Data=rotate.Geometry)
item_2 = ListItem(List=flip, Index=0, Wrap=True)  # -> flatten(Item)
rad_2 = Radians(Degrees=Slider(90, range=0..100))
item_3 = ListItem(List=item_2, Index=0, Wrap=True)
pcen = PolygonCenter(Polyline=item_2)  # -> CenterV, CenterE, CenterA
rotate_2 = Rotate(Geometry=item_2, Angle=rad_2, Plane=item_3)  # -> Geometry, Transform
item_4 = ListItem(List=pcen.CenterV, Index=1, Wrap=True)
item_5 = ListItem(List=pcen.CenterV, Index=0, Wrap=True)
rad_3 = Radians(Degrees=Slider(9, range=0..100))
vec2pt = Vector2Pt(PointA=item_4, PointB=item_5, Unitize=False)  # -> Vector, Length
amp = Amplitude(Vector=vec2pt.Vector, Amplitude=Slider(2.58, range=0..10))
rotate_3 = Rotate(Geometry=rotate_2.Geometry, Angle=rad_3, Plane=item_3)  # -> Geometry, Transform
move_4 = Move(Geometry=rotate_3.Geometry, Motion=amp)  # -> Geometry, Transform
pcen_2 = PolygonCenter(Polyline=move_4.Geometry)  # -> CenterV, CenterE, CenterA
number_slider_8 = Slider(1.7, range=0..10)
item_6 = ListItem(List=pcen_2.CenterV, Index=1, Wrap=True)
item_7 = ListItem(List=pcen_2.CenterV, Index=0, Wrap=True)
vec2pt_2 = Vector2Pt(PointA=item_6, PointB=item_7, Unitize=False)  # -> Vector, Length
amp_2 = Amplitude(Vector=vec2pt_2.Vector, Amplitude=Slider(1.5, range=0..10))
move_5 = Move(Geometry=move_4.Geometry, Motion=amp_2)  # -> Geometry, Transform
number_slider_9 = Slider(1.85, range=0..10)

item_8 = ListItem(List=move_5.Geometry, Index=0, Wrap=True)
explode = Explode(Curve=item_8, Recursive=True)  # -> Segments, Vertices
item_9 = ListItem(List=explode.Vertices, Index=0, Wrap=True)
item_10 = ListItem(List=explode.Vertices, Index=1, Wrap=True)
item_11 = ListItem(List=explode.Vertices, Index=3, Wrap=True)
pl_3pt = Plane3Pt(PointA=item_9, PointB=item_11, PointC=item_10)
deplane = DeconstructPlane(Plane=pl_3pt)  # -> Origin, XAxis, YAxis, ZAxis
amp_3 = Amplitude(Vector=deplane.XAxis, Amplitude=number_slider_9)
neg = Negative(Value=Slider(1.83, range=0..10))
move_6 = Move(Geometry=pl_3pt, Motion=amp_3)  # -> Geometry, Transform
rad_4 = Radians(Degrees=Slider(0, range=0..10))
neg_2 = Negative(Value=rad_4)
prot = RotatePlane(Plane=move_6.Geometry, Angle=neg_2)
orient = Orient(Geometry=item_8, Source=pl_3pt, Target=prot)  # -> Geometry, Transform
deplane_2 = DeconstructPlane(Plane=prot)  # -> Origin, XAxis, YAxis, ZAxis
amp_4 = Amplitude(Vector=deplane_2.XAxis, Amplitude=number_slider_9)
neg_3 = Negative(Value=Slider(1.85, range=0..10))
move_7 = Move(Geometry=prot, Motion=amp_4)  # -> Geometry, Transform
rad_5 = Radians(Degrees=Slider(0, range=0..10))
neg_4 = Negative(Value=rad_5)
prot_2 = RotatePlane(Plane=move_7.Geometry, Angle=neg_4)
orient_2 = Orient(Geometry=orient.Geometry, Source=prot, Target=prot_2)  # -> Geometry, Transform
merge = Merge(Data1=item_8, Data2=orient.Geometry, Data3=orient_2.Geometry)

crv = Curve(merge)
merge_2 = Merge(Data1=rotate.Geometry, Data2=crv)
rotate_4 = Rotate(Geometry=merge_2, Angle=degrees(Slider(-3, range=-10..21)), Plane=PlaneXY(0, 0, 0))  # -> Geometry, Transform
scale = Scale(Geometry=rotate_4.Geometry, Center=Point(0, 0, 0), Factor=Slider(10, range=0..10))  # -> Geometry, Transform
containter = Curve(scale.Geometry)
neg_5 = Negative(Value=Slider(2.25, range=0..10))
neg_6 = Negative(Value=Slider(0.25, range=0..10))
offset = OffsetCurve(Curve=containter, Distance=neg_5, Plane=PlaneXY(0, 0, 0), Corners=1)  # -> flatten(Curve)
offset_2 = OffsetCurve(Curve=containter, Distance=neg_6, Plane=PlaneXY(0, 0, 0), Corners=1)
crv_2 = Curve(flatten(offset_2))
crv_3 = Curve(flatten(offset))
explode_2 = Explode(Curve=offset, Recursive=True)  # -> Segments, Vertices
fillet = Fillet(Curve=crv_2, Radius=Slider(1, range=0..1))
explode_3 = Explode(Curve=crv_2, Recursive=True)  # -> Segments, Vertices
len = Length(Curve=explode_3.Segments)
panel_3 = Panel(len)
offset_3 = OffsetCurve(Curve=crv_2, Distance=1, Corners=1)
len_2 = Length(Curve=explode_2.Segments)
panel_4 = Panel(len_2)
runion = RegionUnion(Curves=flatten(offset_3))
mcu = Curve(<curve referenced from the Rhino model>)
outline = Curve(<curve referenced from the Rhino model>)
runion_2 = RegionUnion(Curves=mcu)
fillet_2 = Fillet(Curve=outline, Radius=Slider(1, range=0..10))
offset_4 = OffsetCurve(Curve=runion_2, Distance=Slider(0.2, range=0..1), Corners=1)
rdiff = RegionDifference(CurvesA=fillet_2, CurvesB=offset_4)
pcb_outline = Curve(rdiff)

# ---- group: switches
pcen_3 = PolygonCenter(Polyline=[offset, mcu])  # -> CenterV, CenterE, CenterA
cir = Circle(Plane=pcen_3.CenterV, Radius=Slider(5, range=0..10))

# ---- group: Diodes
panel_5 = Panel("""0
25
26""")
item_12 = ListItem(List=offset, Index=panel_5, Wrap=True)
cull_i = CullIndex(List=offset, Indices=panel_5, Wrap=True)
rad_6 = Radians(Degrees=Slider(270, range=0..1000))
pcen_4 = PolygonCenter(Polyline=item_12)  # -> CenterV, CenterE, CenterA
rotate_5 = Rotate(Geometry=graft(item_12), Angle=graft(rad_6), Plane=graft(pcen_4.CenterV))  # -> Geometry, Transform
merge_3 = Merge(Data1=cull_i, Data2=rotate_5.Geometry)
hframe = HorizontalFrame(Curve=merge_3, Parameter=graft(Slider(0.5, range=0..1)))
deplane_3 = DeconstructPlane(Plane=hframe)  # -> Origin, XAxis, YAxis, ZAxis
neg_7 = Negative(Value=Slider(0, range=0..10))
amp_5 = Amplitude(Vector=deplane_3.YAxis, Amplitude=neg_7)
neg_8 = Negative(Value=amp_5)
move_8 = Move(Geometry=deplane_3.Origin, Motion=neg_8)  # -> Geometry, Transform
cullpt = CullDuplicates(Points=flatten(move_8.Geometry), Tolerance=0.1, CullMode=3)  # -> Points, Indices, Valence
cir_2 = Circle(Plane=cullpt.Points, Radius=Slider(2.25, range=0..10))

# ---- group: power
item_13 = ListItem(List=offset, Index=Slider(18, range=0..100), Wrap=True)
explode_4 = Explode(Curve=item_13, Recursive=True)  # -> Segments, Vertices
item_14 = ListItem(List=explode_4.Segments, Index=Slider(1, range=0..100), Wrap=True)
neg_9 = Negative(Value=Slider(7.5, range=0..10))
hframe_2 = HorizontalFrame(Curve=item_14, Parameter=Slider(0, range=0..1))
deplane_4 = DeconstructPlane(Plane=hframe_2)  # -> Origin, XAxis, YAxis, ZAxis
amp_6 = Amplitude(Vector=deplane_4.XAxis, Amplitude=neg_9)
move_9 = Move(Geometry=deplane_4.Origin, Motion=amp_6)  # -> Geometry, Transform
amp_7 = Amplitude(Vector=deplane_4.YAxis, Amplitude=Slider(0.2, range=0..10))
move_10 = Move(Geometry=move_9.Geometry, Motion=amp_7)  # -> Geometry, Transform
cir_3 = Circle(Plane=move_10.Geometry, Radius=Slider(2, range=0..10))

# ----
rad_7 = Radians(Degrees=Slider(4.5, range=0..10))
merge_4 = Merge(Data1=cir, Data2=cir_2, Data3=cir_3, Data4=pcb_outline, Data5=crv_3)
rotate_6 = Rotate(Geometry=merge_4, Angle=rad_7, Plane=PlaneXY(0, 0, 0))  # -> Geometry, Transform
X_3 = UnitX(Factor=expr("-x", Slider(70, range=0..100)))
mirror = Mirror(Geometry=rotate_6.Geometry, Plane=PlaneYZ(0, 0, 0))  # -> Geometry, Transform
move_11 = Move(Geometry=mirror.Geometry, Motion=X_3)  # -> Geometry, Transform
merge_5 = Merge(Data1=rotate_6.Geometry, Data2=move_11.Geometry)
crv_4 = Curve(<curve referenced from the Rhino model>)
fillet_3 = FilletDistance(Curve=crv_4, Distance=Slider(1, range=0..1))
crv_5 = Curve(merge_5)
