# Grasshopper definition nii-v3-choc.gh (Grasshopper 1.0.8)

number_slider = Slider(1.75, range=0..10)
number_slider_2 = Slider(1.85, range=0..10)
spacing_vert = Number(number_slider)
spacing_horiz = Number(number_slider_2)
series = Series(Start=0, Step=spacing_vert, Count=Slider(3, range=0..10))
series_2 = Series(Start=0, Step=spacing_horiz, Count=Slider(6, range=0..10))
pt = ConstructPoint(XCoordinate=0, YCoordinate=series, ZCoordinate=0)
panel = Panel("column")
X = UnitX(Factor=series_2)
move = Move(Geometry=pt, Motion=graft(X))  # -> simplify(Geometry), Transform

# ---- group: stagger
outer = Slider(0, range=-3..3)
middle = Slider(1.5, range=-3..3)
ring = Slider(1.2, range=-3..3)
inner = Slider(0, range=-3..3)
pinky = Slider(0, range=-3..3)
index = Slider(0, range=-3..3)

# ----
Y = UnitY(Factor=graft([inner, index, middle, ring, pinky, outer]))
move_2 = Move(Geometry=move.Geometry, Motion=Y)  # -> Geometry, Transform

# ---- group: shift
middle_2 = Slider(-0.05, range=-1..1)
ring_2 = Slider(-0.1, range=-1..1)
pinky_2 = Slider(-0.15, range=-1..1)
outer_2 = Slider(-0.15, range=-1..1)
inner_2 = Slider(0, range=-1..1)
index_2 = Slider(0, range=-1..1)

# ----
pt_2 = Point(move_2.Geometry)
X_2 = UnitX(Factor=graft([inner_2, index_2, middle_2, ring_2, pinky_2, outer_2]))
move_3 = Move(Geometry=pt_2, Motion=X_2)  # -> Geometry, Transform
pt_3 = Point(move_3.Geometry)
num = Number(number_slider)
num_2 = Number(number_slider_2)

# ---- group: splay
number_slider_3 = Slider(-3, range=-30..30)

# ----
dom = ConstructDomain(DomainStart=expr("-x/2", num_2), DomainEnd=expr("x/2", num_2))
dom_2 = ConstructDomain(DomainStart=expr("-x/2", num), DomainEnd=expr("x/2", num))
pt_4 = Point(pt_3)
panel_2 = Panel(dom)
item = ListItem(List=flatten(pt_4), Index=0, Wrap=True)
rectangle = Rectangle(Plane=pt_4, XSize=dom, YSize=dom_2, Radius=0)  # -> Rectangle, Length
num_3 = Number([number_slider_3, Slider(-3, range=-30..30), Slider(0, range=-30..30), Slider(3, range=-30..30), Slider(6, range=-30..30), Slider(6, range=-30..30)])
rad = Radians(Degrees=graft(num_3))  # -> expr("-x", Radians)
rotate = Rotate(Geometry=rectangle.Rectangle, Angle=rad, Plane=item)  # -> Geometry, Transform
flip = FlipMatrix(Data=rotate.Geometry)
pcen = PolygonCenter(Polyline=rotate.Geometry)  # -> CenterV, CenterE, CenterA
number_slider_4 = Slider(1.4, range=0..10)
item_2 = ListItem(List=flip, Index=0, Wrap=True)  # -> flatten(Item)
prot = RotatePlane(Plane=pcen.CenterV, Angle=rad)
rad_2 = Radians(Degrees=Slider(90, range=0..100))
item_3 = ListItem(List=item_2, Index=0, Wrap=True)
pcen_2 = PolygonCenter(Polyline=item_2)  # -> CenterV, CenterE, CenterA
dom_3 = ConstructDomain(DomainStart=expr("-x/2", number_slider_4), DomainEnd=expr("x/2", number_slider_4))
rotate_2 = Rotate(Geometry=item_2, Angle=rad_2, Plane=item_3)  # -> Geometry, Transform
item_4 = ListItem(List=pcen_2.CenterV, Index=1, Wrap=True)
item_5 = ListItem(List=pcen_2.CenterV, Index=0, Wrap=True)
rectangle_2 = Rectangle(Plane=prot, XSize=dom_3, YSize=dom_3, Radius=0)  # -> Rectangle, Length
rad_3 = Radians(Degrees=Slider(9, range=0..100))
vec2pt = Vector2Pt(PointA=item_4, PointB=item_5, Unitize=False)  # -> Vector, Length
amp = Amplitude(Vector=vec2pt.Vector, Amplitude=Slider(2.58, range=0..10))
rotate_3 = Rotate(Geometry=rotate_2.Geometry, Angle=rad_3, Plane=item_3)  # -> Geometry, Transform
move_4 = Move(Geometry=rotate_3.Geometry, Motion=amp)  # -> Geometry, Transform
pcen_3 = PolygonCenter(Polyline=move_4.Geometry)  # -> CenterV, CenterE, CenterA
item_6 = ListItem(List=pcen_3.CenterV, Index=1, Wrap=True)
item_7 = ListItem(List=pcen_3.CenterV, Index=0, Wrap=True)
vec2pt_2 = Vector2Pt(PointA=item_6, PointB=item_7, Unitize=False)  # -> Vector, Length
amp_2 = Amplitude(Vector=vec2pt_2.Vector, Amplitude=Slider(1.5, range=0..10))
move_5 = Move(Geometry=move_4.Geometry, Motion=amp_2)  # -> Geometry, Transform
rad_4 = Radians(Degrees=Slider(90, range=0..100))
number_slider_5 = Slider(1.85, range=0..10)
rad_5 = Radians(Degrees=Slider(12, range=0..100))
number_slider_6 = Slider(1.4, range=0..10)
dom_4 = ConstructDomain(DomainStart=expr("-x/2", number_slider_6), DomainEnd=expr("x/2", number_slider_6))
number_slider_7 = Slider(10, range=0..10)
neg = Negative(Value=Slider(0.25, range=0..10))
mcu = Curve(<curve referenced from the Rhino model>)
outline = Curve(<curve referenced from the Rhino model>)
neg_2 = Negative(Value=Slider(1, range=0..1))
runion = RegionUnion(Curves=mcu)
fillet = Fillet(Curve=outline, Radius=Slider(1, range=0..10))
offset = OffsetCurve(Curve=runion, Distance=Slider(0.2, range=0..1), Corners=1)
offset_2 = OffsetCurve(Curve=outline, Distance=neg_2, Corners=1)
fillet_2 = Fillet(Curve=offset_2, Radius=Slider(0.5, range=0..10))
offset_3 = OffsetCurve(Curve=offset, Distance=Slider(1, range=0..10), Corners=1)
rdiff = RegionDifference(CurvesA=fillet, CurvesB=offset)
pcb_outline = Curve(rdiff)
fonts = QueryInstalledFonts(FontWeight=4, FontStyle=1, FontStretch=5, Symbol=False)
panel_3 = Panel(fonts)
rad_6 = Radians(Degrees=Slider(4.5, range=0..10))
rad_7 = Radians(Degrees=Slider(4.5, range=0..10))
font = ModelFont(Font=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)  # -> Font, FontFamily, FontWeight, FontStyle
rotate_4 = Rotate(Geometry=pcb_outline, Angle=rad_6, Plane=PlaneXY(0, 0, 0))  # -> Geometry, Transform
X_3 = UnitX(Factor=expr("-x", Slider(70, range=0..100)))
as_text = AnnotationTextSettings(Font=font.Font, TextHeight=Slider(2, range=0..10))  # -> TextSettings, Font, TextHeight, TextGap, Mask, MaskColour, MaskMargins, MaskFrame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
X_4 = UnitX(Factor=expr("-x", Slider(70, range=0..100)))
txt = Text("проводник")
mirror = Mirror(Geometry=rotate_4.Geometry, Plane=PlaneYZ(0, 0, 0))  # -> Geometry, Transform
move_6 = Move(Geometry=mirror.Geometry, Motion=X_3)  # -> Geometry, Transform
annotation_style = AnnotationStyle(Name="mystyle", TextSettings=as_text.TextSettings)  # -> AnnotationStyle, Name, ModelScale, TextSettings, DimensionSettings, ArrowSettings, UnitsSettings, LeaderSettings, ToleranceSettings
text_entity = TextEntity(Text=txt, Style=annotation_style.AnnotationStyle)  # -> TextEntity, Plane, Text, Style
merge = Merge(Data1=rotate_4.Geometry, Data2=move_6.Geometry)
crv = Curve([<curve referenced from the Rhino model> x262])
offset_4 = OffsetCurve(Curve=crv, Distance=Slider(0.4, range=0..1), Corners=1)
crv_2 = Curve(<curve referenced from the Rhino model>)
join = JoinCurves(Curves=crv_2, Preserve=False)
number_slider_8 = Slider(1, range=0..1)
crv_3 = Curve(<curve referenced from the Rhino model>)
neg_3 = Negative(Value=Slider(1, range=0..10))
offset_5 = OffsetCurve(Curve=join, Distance=neg_3, Corners=1)
fillet_3 = FilletDistance(Curve=offset_5, Distance=Slider(0.5, range=0..1))

item_8 = ListItem(List=move_5.Geometry, Index=0, Wrap=True)
rad_8 = Radians(Degrees=Slider(0, range=0..10))
neg_4 = Negative(Value=rad_8)
rad_9 = Radians(Degrees=Slider(0, range=0..10))
neg_5 = Negative(Value=rad_9)

pcen_4 = PolygonCenter(Polyline=item_8)  # -> CenterV, CenterE, CenterA
rotate_5 = Rotate(Geometry=item_8, Angle=rad_4, Plane=pcen_4.CenterV)  # -> Geometry, Transform
crv_4 = Curve(rotate_5.Geometry)

explode = Explode(Curve=crv_4, Recursive=True)  # -> Segments, Vertices
item_9 = ListItem(List=explode.Vertices, Index=0, Wrap=True)
item_10 = ListItem(List=explode.Vertices, Index=1, Wrap=True)
item_11 = ListItem(List=explode.Vertices, Index=3, Wrap=True)
pl_3pt = Plane3Pt(PointA=item_9, PointB=item_10, PointC=item_11)
deplane = DeconstructPlane(Plane=pl_3pt)  # -> Origin, XAxis, YAxis, ZAxis
amp_3 = Amplitude(Vector=deplane.XAxis, Amplitude=number_slider_5)
move_7 = Move(Geometry=pl_3pt, Motion=amp_3)  # -> Geometry, Transform
prot_2 = RotatePlane(Plane=move_7.Geometry, Angle=neg_4)
orient = Orient(Geometry=crv_4, Source=pl_3pt, Target=prot_2)  # -> Geometry, Transform
deplane_2 = DeconstructPlane(Plane=prot_2)  # -> Origin, XAxis, YAxis, ZAxis
amp_4 = Amplitude(Vector=deplane_2.XAxis, Amplitude=number_slider_5)
move_8 = Move(Geometry=prot_2, Motion=amp_4)  # -> Geometry, Transform
prot_3 = RotatePlane(Plane=move_8.Geometry, Angle=neg_5)
orient_2 = Orient(Geometry=orient.Geometry, Source=prot_2, Target=prot_3)  # -> Geometry, Transform
merge_2 = Merge(Data1=crv_4, Data2=orient.Geometry, Data3=orient_2.Geometry)

crv_5 = Curve(merge_2)
pcen_5 = PolygonCenter(Polyline=crv_5)  # -> CenterV, CenterE, CenterA
prot_4 = RotatePlane(Plane=pcen_5.CenterV, Angle=rad_5)
merge_3 = Merge(Data1=rotate.Geometry, Data2=crv_5)
rotate_6 = Rotate(Geometry=merge_3, Angle=degrees(Slider(-3, range=-10..21)), Plane=PlaneXY(0, 0, 0))  # -> Geometry, Transform
rectangle_3 = Rectangle(Plane=prot_4, XSize=dom_4, YSize=dom_4, Radius=0)  # -> Rectangle, Length
merge_4 = Merge(Data1=rectangle_2.Rectangle, Data2=rectangle_3.Rectangle)
rotate_7 = Rotate(Geometry=merge_4, Angle=degrees(Slider(-3, range=-10..21)), Plane=PlaneXY(0, 0, 0))  # -> Geometry, Transform
scale = Scale(Geometry=rotate_6.Geometry, Center=Point(0, 0, 0), Factor=number_slider_7)  # -> Geometry, Transform
scale_2 = Scale(Geometry=rotate_7.Geometry, Center=Point(0, 0, 0), Factor=number_slider_7)  # -> Geometry, Transform
containter = Curve(scale.Geometry)
explode_2 = Explode(Curve=scale_2.Geometry, Recursive=True)  # -> Segments, Vertices
len = Length(Curve=explode_2.Segments)
panel_4 = Panel(len)
offset_6 = OffsetCurve(Curve=containter, Distance=neg, Plane=PlaneXY(0, 0, 0), Corners=1)
crv_6 = Curve(flatten(offset_6))
crv_7 = Curve(flatten(scale_2.Geometry))
explode_3 = Explode(Curve=scale_2.Geometry, Recursive=True)  # -> Segments, Vertices
fillet_4 = Fillet(Curve=crv_6, Radius=Slider(1, range=0..1))
explode_4 = Explode(Curve=crv_6, Recursive=True)  # -> Segments, Vertices
len_2 = Length(Curve=explode_4.Segments)
len_3 = Length(Curve=explode_3.Segments)
panel_5 = Panel(len_2)
panel_6 = Panel(len_3)

# ---- group: switches
pcen_6 = PolygonCenter(Polyline=[scale_2.Geometry, mcu])  # -> CenterV, CenterE, CenterA
cir = Circle(Plane=pcen_6.CenterV, Radius=Slider(5, range=0..10))

# ---- group: power
item_12 = ListItem(List=flatten(scale_2.Geometry), Index=Slider(18, range=0..100), Wrap=True)
explode_5 = Explode(Curve=item_12, Recursive=True)  # -> Segments, Vertices
item_13 = ListItem(List=explode_5.Segments, Index=Slider(1, range=0..100), Wrap=True)
neg_6 = Negative(Value=Slider(7.5, range=0..10))
hframe = HorizontalFrame(Curve=item_13, Parameter=Slider(0, range=0..1))
deplane_3 = DeconstructPlane(Plane=hframe)  # -> Origin, XAxis, YAxis, ZAxis
amp_5 = Amplitude(Vector=deplane_3.XAxis, Amplitude=neg_6)
move_9 = Move(Geometry=deplane_3.Origin, Motion=amp_5)  # -> Geometry, Transform
amp_6 = Amplitude(Vector=deplane_3.YAxis, Amplitude=Slider(0.2, range=0..10))
move_10 = Move(Geometry=move_9.Geometry, Motion=amp_6)  # -> Geometry, Transform
cir_2 = Circle(Plane=move_10.Geometry, Radius=Slider(2, range=0..10))

# ---- group: Diodes
hframe_2 = HorizontalFrame(Curve=scale_2.Geometry, Parameter=graft(Slider(0.5, range=0..1)))
deplane_4 = DeconstructPlane(Plane=hframe_2)  # -> Origin, XAxis, YAxis, ZAxis
neg_7 = Negative(Value=Slider(0, range=0..10))
amp_7 = Amplitude(Vector=deplane_4.YAxis, Amplitude=neg_7)
neg_8 = Negative(Value=amp_7)
move_11 = Move(Geometry=deplane_4.Origin, Motion=neg_8)  # -> Geometry, Transform
cullpt = CullDuplicates(Points=flatten(move_11.Geometry), Tolerance=0.1, CullMode=3)  # -> Points, Indices, Valence
cir_3 = Circle(Plane=cullpt.Points, Radius=Slider(2.25, range=0..10))

# ----
merge_5 = Merge(Data1=cir, Data2=cir_3, Data3=cir_2, Data5=crv_7)
rotate_8 = Rotate(Geometry=merge_5, Angle=rad_7, Plane=PlaneXY(0, 0, 0))  # -> Geometry, Transform
mirror_2 = Mirror(Geometry=rotate_8.Geometry, Plane=PlaneYZ(0, 0, 0))  # -> Geometry, Transform
move_12 = Move(Geometry=mirror_2.Geometry, Motion=X_4)  # -> Geometry, Transform
merge_6 = Merge(Data1=rotate_8.Geometry, Data2=move_12.Geometry)
crv_8 = Curve(merge_6)
