# Grasshopper definition niokr_gen-case.gh (Grasshopper 1.0.8)

number_slider = Slider(1.85, range=0..10)
num = Number(number_slider)
series = Series(Start=0, Step=num, Count=Slider(3, range=0..10))
series_2 = Series(Start=0, Step=num, Count=Slider(6, range=0..10))
panel = Panel("column")
pt = ConstructPoint(XCoordinate=0, YCoordinate=series, ZCoordinate=0)
X = UnitX(Factor=series_2)
move = Move(Geometry=pt, Motion=graft(X))  # -> simplify(Geometry), Transform

# ---- group: stagger
outer = Slider(0, range=-3..3)
middle = Slider(1.5, range=-3..3)
ring = Slider(1.2, range=-3..3)
pinky = Slider(0, range=-3..3)
inner = Slider(0, range=-3..3)
index = Slider(0, range=-3..3)

# ----
Y = UnitY(Factor=graft([inner, index, middle, ring, pinky, outer]))
move_2 = Move(Geometry=move.Geometry, Motion=Y)  # -> Geometry, Transform
rad = Radians(Degrees=Slider(90, range=0..100))

# ---- group: shift
ring_2 = Slider(-0.1, range=-1..1)
middle_2 = Slider(-0.05, range=-1..1)
pinky_2 = Slider(-0.15, range=-1..1)
outer_2 = Slider(-0.15, range=-1..1)
inner_2 = Slider(0, range=-1..1)
index_2 = Slider(0, range=-1..1)

# ----
pt_2 = Point(move_2.Geometry)
X_2 = UnitX(Factor=graft([inner_2, index_2, middle_2, ring_2, pinky_2, outer_2]))
move_3 = Move(Geometry=pt_2, Motion=X_2)  # -> Geometry, Transform
pt_3 = Point(move_3.Geometry)
num_2 = Number(number_slider)
number_slider_2 = Slider(0, range=-30..30)
number_slider_3 = Slider(-3, range=-30..30)

# ---- group: splay
number_slider_4 = Slider(-3, range=-30..30)

# ----
number_slider_5 = Slider(3, range=-30..30)
number_slider_6 = Slider(6, range=-30..30)
number_slider_7 = Slider(6, range=-30..30)
dom = ConstructDomain(DomainStart=expr("-x/2", num_2), DomainEnd=expr("x/2", num_2))
pt_4 = Point(pt_3)
panel_2 = Panel(dom)
item = ListItem(List=flatten(pt_4), Index=0, Wrap=True)
rectangle = Rectangle(Plane=pt_4, XSize=dom, YSize=dom, Radius=0)  # -> Rectangle, Length
num_3 = Number([number_slider_4, number_slider_3, number_slider_2, number_slider_5, number_slider_6, number_slider_7])
rad_2 = Radians(Degrees=graft([number_slider_4, number_slider_3, number_slider_2, number_slider_5, number_slider_6, number_slider_7]))  # -> expr("-x", Radians)
rotate = Rotate(Geometry=rectangle.Rectangle, Angle=rad_2, Plane=item)  # -> Geometry, Transform
flip = FlipMatrix(Data=rotate.Geometry)
item_2 = ListItem(List=flip, Index=0, Wrap=True)  # -> flatten(Item)
item_3 = ListItem(List=item_2, Index=0, Wrap=True)
pcen = PolygonCenter(Polyline=item_2)  # -> CenterV, CenterE, CenterA
rotate_2 = Rotate(Geometry=item_2, Angle=rad, Plane=item_3)  # -> Geometry, Transform
item_4 = ListItem(List=pcen.CenterV, Index=1, Wrap=True)
item_5 = ListItem(List=pcen.CenterV, Index=0, Wrap=True)
vec2pt = Vector2Pt(PointA=item_4, PointB=item_5, Unitize=False)  # -> Vector, Length
amp = Amplitude(Vector=vec2pt.Vector, Amplitude=Slider(2.5, range=0..10))
move_4 = Move(Geometry=rotate_2.Geometry, Motion=amp)  # -> Geometry, Transform
pcen_2 = PolygonCenter(Polyline=move_4.Geometry)  # -> CenterV, CenterE, CenterA
item_6 = ListItem(List=pcen_2.CenterV, Index=1, Wrap=True)
item_7 = ListItem(List=pcen_2.CenterV, Index=0, Wrap=True)
vec2pt_2 = Vector2Pt(PointA=item_6, PointB=item_7, Unitize=False)  # -> Vector, Length
move_5 = Move(Geometry=move_4.Geometry, Motion=vec2pt_2.Vector)  # -> Geometry, Transform
item_8 = ListItem(List=move_5.Geometry, Index=2, Wrap=True)
item_9 = ListItem(List=move_5.Geometry, Index=[0, 1], Wrap=True)
explode = Explode(Curve=item_8, Recursive=True)  # -> Segments, Vertices
rad_3 = Radians(Degrees=Slider(9, range=0..100))
item_10 = ListItem(List=explode.Vertices, Index=0, Wrap=True)
rotate_3 = Rotate(Geometry=item_8, Angle=rad_3, Plane=item_10)  # -> Geometry, Transform
merge = Merge(Data1=item_9, Data2=rotate_3.Geometry)
flip_2 = Flip(Surface=merge)  # -> Surface, Result
crv = Curve(flip_2.Surface)
merge_2 = Merge(Data1=rotate.Geometry, Data2=crv)
rotate_4 = Rotate(Geometry=merge_2, Angle=degrees(Slider(-3, range=-10..21)), Plane=PlaneXY(0, 0, 0))  # -> Geometry, Transform
scale = Scale(Geometry=rotate_4.Geometry, Center=Point(0, 0, 0), Factor=Slider(10, range=0..10))  # -> Geometry, Transform
containter = Curve(scale.Geometry)
offset = OffsetCurve(Curve=containter, Distance=Slider(1, range=0..1), Plane=PlaneXY(0, 0, 0), Corners=1)
neg = Negative(Value=Slider(2.25, range=0..10))
neg_2 = Negative(Value=Slider(0.25, range=0..10))
offset_2 = OffsetCurve(Curve=containter, Distance=neg, Plane=PlaneXY(0, 0, 0), Corners=1)  # -> flatten(Curve)
runion = RegionUnion(Curves=flatten(offset))
offset_3 = OffsetCurve(Curve=containter, Distance=neg_2, Plane=PlaneXY(0, 0, 0), Corners=1)
crv_2 = Curve(flatten(offset_2))
crv_3 = Curve(flatten(offset_2))
crv_4 = Curve(flatten(offset_3))
crv_5 = Curve(<curve referenced from the Rhino model>)
offset_4 = OffsetCurve(Curve=crv_2, Distance=Slider(0.5, range=0..1), Corners=1)  # -> flatten(Curve)
explode_2 = Explode(Curve=offset_2, Recursive=True)  # -> Segments, Vertices
len = Length(Curve=explode_2.Segments)
fillet = Fillet(Curve=crv_4, Radius=Slider(1, range=0..1))
offset_5 = OffsetCurve(Curve=runion, Distance=Slider(1, range=0..1), Plane=PlaneXY(0, 0, 0), Corners=1)
explode_3 = Explode(Curve=crv_4, Recursive=True)  # -> Segments, Vertices
len_2 = Length(Curve=explode_3.Segments)
panel_3 = Panel(len_2)
offset_6 = OffsetCurve(Curve=crv_5, Distance=Slider(1, range=0..1), Corners=1)  # -> flatten(Curve)
neg_3 = Negative(Value=Slider(4.6, range=0..10))
panel_4 = Panel(len)
neg_4 = Negative(Value=Slider(2, range=0..10))
Z = UnitZ(Factor=neg_3)
rdiff = RegionDifference(CurvesA=crv_5, CurvesB=offset_4)
rdiff_2 = RegionDifference(CurvesA=offset_6, CurvesB=crv_2)
offset_7 = OffsetCurve(Curve=offset_5, Distance=neg_4, Plane=PlaneXY(0, 0, 0), Corners=1)
range = Range(Domain=Domain(0, 1), Steps=10)
move_6 = Move(Geometry=offset_6, Motion=Z)  # -> Geometry, Transform
num_4 = Number(Slider(0.5, range=0..1))
boundary = BoundarySurfaces(Edges=rdiff_2)
boundary_2 = BoundarySurfaces(Edges=rdiff)
eval = EvaluateCurve(Curve=reparameterize(move_6.Geometry), Parameter=num_4)  # -> Point, Tangent, Angle
eval_2 = EvaluateCurve(Curve=reparameterize(crv_5), Parameter=num_4)  # -> Point, Tangent, Angle
mcu = Curve([<curve referenced from the Rhino model> x2])
outline = Curve(<curve referenced from the Rhino model>)
Z_2 = UnitZ(Factor=Slider(2.2, range=0..10))
move_7 = Move(Geometry=boundary_2, Motion=Z_2)  # -> Geometry, Transform
offset_8 = OffsetCurve(Curve=offset_7, Distance=Slider(0.75, range=0..10), Plane=PlaneXY(0, 0, 0), Corners=1)
extr = Extrude(Base=boundary, Direction=Z_2)
runion_2 = RegionUnion(Curves=mcu)
intcrv = Interpolate(Vertices=[eval_2.Point, eval.Point], Degree=3, Periodic=False, KnotStyle=1)  # -> Curve, Length, Domain
fillet_2 = Fillet(Curve=outline, Radius=Slider(2, range=0..10))
crv_6 = Curve(<curve referenced from the Rhino model>)
crv_7 = Curve(<curve referenced from the Rhino model>)
Z_3 = UnitZ(Factor=Slider(3.3, range=0..10))
offset_9 = OffsetCurve(Curve=runion_2, Distance=Slider(0.2, range=0..1), Corners=1)
extr_2 = Extrude(Base=move_7.Geometry, Direction=Z_3)
item_11 = ListItem(List=mcu, Index=1, Wrap=True)
swp2 = Sweep2(Rail1=crv_7, Rail2=move_6.Geometry, Sections=crv_6, SameHeight=True)
rdiff_3 = RegionDifference(CurvesA=fillet_2, CurvesB=offset_9)
pcb_outline = Curve(rdiff_3)
pcen_3 = PolygonCenter(Polyline=[item_11, offset_2])  # -> CenterV, CenterE, CenterA
Z_4 = UnitZ(Factor=Slider(5, range=0..10))
boundary_3 = BoundarySurfaces(Edges=offset_2)
boundary_4 = BoundarySurfaces(Edges=pcb_outline)
Z_5 = UnitZ(Factor=Slider(1.5, range=0..10))
extr_3 = Extrude(Base=boundary_3, Direction=Z_4)
extr_4 = Extrude(Base=boundary_4, Direction=Z_5)
cir = Circle(Plane=pcen_3.CenterV, Radius=Slider(5, range=0..10))
sdiff = SolidDifference(BrepsA=extr_4, BrepsB=extr_3)
merge_3 = Merge(Data1=sdiff)

hframe = HorizontalFrame(Curve=reparameterize(offset_2), Parameter=graft(Slider(0.8, range=0..1)))
hframe_2 = HorizontalFrame(Curve=reparameterize(offset_2), Parameter=graft(Slider(0.45, range=0..1)))
deplane = DeconstructPlane(Plane=hframe)  # -> Origin, XAxis, YAxis, ZAxis
deplane_2 = DeconstructPlane(Plane=hframe_2)  # -> Origin, XAxis, YAxis, ZAxis
neg_5 = Negative(Value=Slider(0, range=0..10))
neg_6 = Negative(Value=Slider(0, range=0..10))
amp_2 = Amplitude(Vector=deplane.YAxis, Amplitude=neg_5)
amp_3 = Amplitude(Vector=deplane_2.YAxis, Amplitude=neg_6)
neg_7 = Negative(Value=amp_2)
neg_8 = Negative(Value=amp_3)
move_8 = Move(Geometry=deplane.Origin, Motion=neg_7)  # -> Geometry, Transform
move_9 = Move(Geometry=deplane_2.Origin, Motion=neg_8)  # -> Geometry, Transform
cullpt = CullDuplicates(Points=flatten(move_8.Geometry), Tolerance=0.1, CullMode=3)  # -> Points, Indices, Valence
cullpt_2 = CullDuplicates(Points=flatten(move_9.Geometry), Tolerance=0.1, CullMode=3)  # -> Points, Indices, Valence
cir_2 = Circle(Plane=cullpt.Points, Radius=Slider(2.25, range=0..10))
cir_3 = Circle(Plane=cullpt_2.Points, Radius=Slider(2.25, range=0..10))

item_12 = ListItem(List=offset_2, Index=Slider(18, range=0..100), Wrap=True)
explode_4 = Explode(Curve=item_12, Recursive=True)  # -> Segments, Vertices
item_13 = ListItem(List=explode_4.Segments, Index=Slider(1, range=0..100), Wrap=True)
neg_9 = Negative(Value=Slider(7.5, range=0..10))
hframe_3 = HorizontalFrame(Curve=item_13, Parameter=Slider(0, range=0..1))
deplane_3 = DeconstructPlane(Plane=hframe_3)  # -> Origin, XAxis, YAxis, ZAxis
amp_4 = Amplitude(Vector=deplane_3.XAxis, Amplitude=neg_9)
move_10 = Move(Geometry=deplane_3.Origin, Motion=amp_4)  # -> Geometry, Transform
amp_5 = Amplitude(Vector=deplane_3.YAxis, Amplitude=Slider(0.2, range=0..10))
move_11 = Move(Geometry=move_10.Geometry, Motion=amp_5)  # -> Geometry, Transform
cir_4 = Circle(Plane=move_11.Geometry, Radius=Slider(2, range=0..10))

crv_8 = Curve(outline)
explode_5 = Explode(Curve=crv_8, Recursive=True)  # -> Segments, Vertices
item_14 = ListItem(List=explode_5.Segments, Index=Slider(2, range=0..10), Wrap=True)
number_slider_8 = Slider(15, range=0..100)
hframe_4 = HorizontalFrame(Curve=reparameterize(item_14), Parameter=Slider(0.5, range=0..1))
dom_2 = ConstructDomain(DomainStart=expr("-x", number_slider_8), DomainEnd=number_slider_8)
dom_3 = ConstructDomain(DomainStart=expr("-x", 0), DomainEnd=Slider(45, range=0..100))
rectangle_2 = Rectangle(Plane=hframe_4, XSize=dom_2, YSize=dom_3, Radius=0)  # -> Rectangle, Length
explode_6 = Explode(Curve=rectangle_2.Rectangle, Recursive=True)  # -> Segments, Vertices
item_15 = ListItem(List=explode_6.Segments, Index=[2, 0], Wrap=True)
number_slider_9 = Slider(3, range=0..10)
number_slider_10 = Slider(6, range=0..10)
eval_3 = EvaluateCurve(Curve=reparameterize(item_15), Parameter=Slider(0.5, range=0..1))  # -> Point, Tangent, Angle
dom_4 = ConstructDomain(DomainStart=expr("-x", number_slider_10), DomainEnd=number_slider_10)
dom_5 = ConstructDomain(DomainStart=expr("-x", number_slider_9), DomainEnd=number_slider_9)
merge_4 = Merge(Data1=cir_4, Data2=cir_2, Data3=cir)
merge_5 = Merge(Data1=cir_4, Data2=cir_3, Data3=cir)
rectangle_3 = Rectangle(Plane=eval_3.Point, XSize=dom_5, YSize=dom_4, Radius=0)  # -> Rectangle, Length
X_3 = UnitX(Factor=expr("-x", Slider(65, range=0..100)))
mirror = Mirror(Geometry=merge_5, Plane=PlaneYZ(0, 0, 0))  # -> Geometry, Transform
fillet_3 = Fillet(Curve=rectangle_3.Rectangle, Radius=number_slider_9)
cir_5 = Circle(Plane=explode_6.Vertices, Radius=number_slider_9)
move_12 = Move(Geometry=mirror.Geometry, Motion=X_3)  # -> Geometry, Transform
rdiff_4 = RegionDifference(CurvesA=rectangle_2.Rectangle, CurvesB=[cir_5, fillet_3])
number_slider_11 = Slider(5, range=0..10)
number_slider_12 = Slider(13, range=0..20)
number_slider_13 = Slider(9, range=0..10)
number_slider_14 = Slider(1, range=0..10)
explode_7 = Explode(Curve=rdiff_4, Recursive=True)  # -> Segments, Vertices
merge_6 = Merge(Data1=merge_4, Data2=move_12.Geometry)
number_slider_15 = Slider(7, range=0..20)
cull_i = CullIndex(List=explode_7.Segments, Indices=[number_slider_14, number_slider_11, number_slider_13, number_slider_12], Wrap=True)
item_16 = ListItem(List=explode_7.Segments, Index=[number_slider_14, number_slider_11, number_slider_13, number_slider_12], Wrap=True)
join = JoinCurves(Curves=cull_i, Preserve=False)
item_17 = ListItem(List=item_16, Index=[0, 1], Wrap=True)
crv_9 = Curve(pcb_outline)
midpt = CurveMiddle(Curve=item_16)
midpt_2 = CurveMiddle(Curve=item_17)
difference = SetDifference(SetA=midpt, SetB=midpt_2)
X_4 = UnitX(Factor=expr("-x", Slider(65, range=0..100)))
fillet_4 = Fillet(Curve=join, Radius=Slider(1, range=0..10))
mirror_2 = Mirror(Geometry=crv_9, Plane=PlaneYZ(0, 0, 0))  # -> Geometry, Transform
index_3 = ItemIndex(List=midpt, Item=difference)
item_18 = ListItem(List=item_16, Index=index_3, Wrap=True)
move_13 = Move(Geometry=mirror_2.Geometry, Motion=X_4)  # -> Geometry, Transform
flip_3 = FlipCurve(Curve=item_18)  # -> Curve, Flag
merge_7 = Merge(Data1=crv_9, Data2=move_13.Geometry)
join_2 = JoinCurves(Curves=flatten([item_16, fillet_4]), Preserve=False)
merge_8 = Merge(Data1=flip_3.Curve, Data2=item_17)
divdist = DivideDistance(Curve=merge_8, Distance=Slider(1, range=0..1))  # -> Points, Tangents, Parameters
cull_i_2 = CullIndex(List=divdist.Points, Indices=Slider(0, range=0..100), Wrap=True)
Y_2 = UnitY(Factor=expr("-x", Slider(0.5, range=0..1)))
move_14 = Move(Geometry=cull_i_2, Motion=Y_2)  # -> Geometry, Transform
cir_6 = Circle(Plane=flatten(move_14.Geometry), Radius=Slider(0.3, range=0..1))
runion_3 = RegionUnion(Curves=flatten([merge_7, join_2]))
merge_9 = Merge(Data1=runion_3, Data2=cir_6)
