# Grasshopper definition niokr_gen.gh (Grasshopper 1.0.8)

number_slider = Slider(1.95, range=0..10)
num = Number(number_slider)
series = Series(Start=0, Step=num, Count=Slider(3, range=0..10))
series_2 = Series(Start=0, Step=num, Count=Slider(6, range=0..10))
panel = Panel("column")
pt = ConstructPoint(XCoordinate=0, YCoordinate=series, ZCoordinate=0)
X = UnitX(Factor=series_2)
move = Move(Geometry=pt, Motion=graft(X))  # -> simplify(Geometry), Transform

# ---- group: stagger
middle = Slider(1.5, range=-3..3)
outer = Slider(0, range=-3..3)
ring = Slider(1.2, range=-3..3)
inner = Slider(0, range=-3..3)
pinky = Slider(0, range=-3..3)
index = Slider(0, range=-3..3)

# ----
Y = UnitY(Factor=graft([inner, index, middle, ring, pinky, outer]))
move_2 = Move(Geometry=move.Geometry, Motion=Y)  # -> Geometry, Transform
rad = Radians(Degrees=Slider(90, range=0..100))

# ---- group: shift
middle_2 = Slider(-0.05, range=-1..1)
ring_2 = Slider(-0.1, range=-1..1)
pinky_2 = Slider(-0.15, range=-1..1)
outer_2 = Slider(-0.15, range=-1..1)
inner_2 = Slider(0, range=-1..1)
index_2 = Slider(0, range=-1..1)

# ----
pt_2 = Point(move_2.Geometry)
X_2 = UnitX(Factor=graft([inner_2, index_2, middle_2, ring_2, pinky_2, outer_2]))
move_3 = Move(Geometry=pt_2, Motion=X_2)  # -> Geometry, Transform
pt_3 = Point(move_3.Geometry)
num_2 = Number(number_slider)
number_slider_2 = Slider(0, range=-30..30)

# ---- group: splay
number_slider_3 = Slider(-3, range=-30..30)

# ----
number_slider_4 = Slider(-3, range=-30..30)
number_slider_5 = Slider(3, range=-30..30)
number_slider_6 = Slider(6, range=-30..30)
number_slider_7 = Slider(6, range=-30..30)
dom = ConstructDomain(DomainStart=expr("-x/2", num_2), DomainEnd=expr("x/2", num_2))
pt_4 = Point(pt_3)
panel_2 = Panel(dom)
item = ListItem(List=flatten(pt_4), Index=0, Wrap=True)
rectangle = Rectangle(Plane=pt_4, XSize=dom, YSize=dom, Radius=0)  # -> Rectangle, Length
num_3 = Number([number_slider_3, number_slider_4, number_slider_2, number_slider_5, number_slider_6, number_slider_7])
rad_2 = Radians(Degrees=graft([number_slider_3, number_slider_4, number_slider_2, number_slider_5, number_slider_6, number_slider_7]))  # -> expr("-x", Radians)
rotate = Rotate(Geometry=rectangle.Rectangle, Angle=rad_2, Plane=item)  # -> Geometry, Transform
flip = FlipMatrix(Data=rotate.Geometry)
item_2 = ListItem(List=flip, Index=0, Wrap=True)  # -> flatten(Item)
item_3 = ListItem(List=item_2, Index=0, Wrap=True)
pcen = PolygonCenter(Polyline=item_2)  # -> CenterV, CenterE, CenterA
rotate_2 = Rotate(Geometry=item_2, Angle=rad, Plane=item_3)  # -> Geometry, Transform
item_4 = ListItem(List=pcen.CenterV, Index=1, Wrap=True)
item_5 = ListItem(List=pcen.CenterV, Index=0, Wrap=True)
vec2pt = Vector2Pt(PointA=item_4, PointB=item_5, Unitize=False)  # -> Vector, Length
amp = Amplitude(Vector=vec2pt.Vector, Amplitude=Slider(2.5, range=0..10))
move_4 = Move(Geometry=rotate_2.Geometry, Motion=amp)  # -> Geometry, Transform
pcen_2 = PolygonCenter(Polyline=move_4.Geometry)  # -> CenterV, CenterE, CenterA
item_6 = ListItem(List=pcen_2.CenterV, Index=1, Wrap=True)
item_7 = ListItem(List=pcen_2.CenterV, Index=0, Wrap=True)
vec2pt_2 = Vector2Pt(PointA=item_6, PointB=item_7, Unitize=False)  # -> Vector, Length
move_5 = Move(Geometry=move_4.Geometry, Motion=vec2pt_2.Vector)  # -> Geometry, Transform
item_8 = ListItem(List=move_5.Geometry, Index=2, Wrap=True)
item_9 = ListItem(List=move_5.Geometry, Index=[0, 1], Wrap=True)
explode = Explode(Curve=item_8, Recursive=True)  # -> Segments, Vertices
rad_3 = Radians(Degrees=Slider(9, range=0..100))
item_10 = ListItem(List=explode.Vertices, Index=0, Wrap=True)
rotate_3 = Rotate(Geometry=item_8, Angle=rad_3, Plane=item_10)  # -> Geometry, Transform
merge = Merge(Data1=item_9, Data2=rotate_3.Geometry)
merge_2 = Merge(Data1=rotate.Geometry, Data2=merge)
rotate_4 = Rotate(Geometry=merge_2, Angle=degrees(Slider(-3, range=-10..21)), Plane=PlaneXY(0, 0, 0))  # -> Geometry, Transform
crv = Curve(rotate_4.Geometry)
scale = Scale(Geometry=crv, Center=Point(0, 0, 0), Factor=Slider(10, range=0..10))  # -> Geometry, Transform
offset = OffsetCurve(Curve=scale.Geometry, Distance=Slider(1, range=0..1), Plane=PlaneXY(0, 0, 0), Corners=1)
neg = Negative(Value=Slider(2.75, range=0..10))
neg_2 = Negative(Value=Slider(0.75, range=0..10))
offset_2 = OffsetCurve(Curve=scale.Geometry, Distance=neg, Plane=PlaneXY(0, 0, 0), Corners=1)
offset_3 = OffsetCurve(Curve=scale.Geometry, Distance=Slider(0.75, range=0..1), Plane=PlaneXY(0, 0, 0), Corners=1)
runion = RegionUnion(Curves=flatten(offset))
offset_4 = OffsetCurve(Curve=scale.Geometry, Distance=neg_2, Plane=PlaneXY(0, 0, 0), Corners=1)
crv_2 = Curve(flatten(offset_2))
crv_3 = Curve(flatten(offset_4))
number_slider_8 = Slider(1, range=0..1)
runion_2 = RegionUnion(Curves=flatten(offset_3))
explode_2 = Explode(Curve=crv_2, Recursive=True)  # -> Segments, Vertices
len = Length(Curve=explode_2.Segments)
panel_3 = Panel(len)
offset_5 = OffsetCurve(Curve=runion, Distance=Slider(1, range=0..1), Plane=PlaneXY(0, 0, 0), Corners=1)
explode_3 = Explode(Curve=crv_3, Recursive=True)  # -> Segments, Vertices
len_2 = Length(Curve=explode_3.Segments)
panel_4 = Panel(len_2)
offset_6 = OffsetCurve(Curve=runion_2, Distance=Slider(0.95, range=0..1), Plane=PlaneXY(0, 0, 0), Corners=1)
neg_3 = Negative(Value=Slider(2, range=0..10))
offset_7 = OffsetCurve(Curve=offset_5, Distance=neg_3, Plane=PlaneXY(0, 0, 0), Corners=1)
neg_4 = Negative(Value=Slider(0.95, range=0..1))
crv_4 = Curve(<curve referenced from the Rhino model>)
offset_8 = OffsetCurve(Curve=offset_6, Distance=neg_4, Plane=PlaneXY(0, 0, 0), Corners=1)
fillet = Fillet(Curve=crv_4, Radius=Slider(1.5, range=0..10))
number_slider_9 = Slider(83.5, range=0..100)
offset_9 = OffsetCurve(Curve=offset_8, Distance=Slider(1.5, range=0..10), Plane=PlaneXY(0, 0, 0), Corners=1)
mcu = Curve([<curve referenced from the Rhino model> x2])
sqrt = SquareRoot(Value=Slider(2, range=0..10))
number_slider_10 = Slider(1, range=0..1)
outline = Curve(<curve referenced from the Rhino model>)
multiplication = Multiplication(A=number_slider_9, B=sqrt)
runion_3 = RegionUnion(Curves=mcu)
offset_10 = OffsetCurve(Curve=runion_3, Distance=Slider(0.2, range=0..1), Corners=1)
dom_2 = ConstructDomain(DomainStart=0, DomainEnd=number_slider_9)
dom_3 = ConstructDomain(DomainStart=0, DomainEnd=Slider(118, range=0..1000))
pt_5 = Point(Point(-32.06039471, -34.75, 0))
fillet_2 = Fillet(Curve=outline, Radius=Slider(2, range=0..10))
rectangle_2 = Rectangle(Plane=pt_5, XSize=dom_3, YSize=dom_2, Radius=0)  # -> Rectangle, Length
rdiff = RegionDifference(CurvesA=fillet_2, CurvesB=offset_10)
crv_5 = Curve(rdiff)
crv_6 = Curve(crv_2)
number_slider_11 = Slider(1.5, range=0..10)
crv_7 = Curve(crv_6)
boundary = BoundarySurfaces(Edges=crv_7)
Z = UnitZ(Factor=Slider(5, range=0..10))
boundary_2 = BoundarySurfaces(Edges=crv_5)
Z_2 = UnitZ(Factor=number_slider_11)
Z_3 = UnitZ(Factor=number_slider_11)
extr = Extrude(Base=boundary, Direction=Z)
extr_2 = Extrude(Base=boundary_2, Direction=Z_2)
neg_5 = Negative(Value=Z_3)
crv_8 = Curve(crv_3)
move_6 = Move(Geometry=extr_2, Motion=neg_5)  # -> Geometry, Transform
pcen_3 = PolygonCenter(Polyline=crv_8)  # -> CenterV, CenterE, CenterA
crv_9 = Curve(<curve referenced from the Rhino model>)
sdiff = SolidDifference(BrepsA=extr_2, BrepsB=extr)
cir = Circle(Plane=pcen_3.CenterV, Radius=Slider(3, range=0..10))
merge_3 = Merge(Data1=sdiff)
merge_4 = Merge(Data1=crv_9, Data3=cir)
X_3 = UnitX(Factor=expr("-x", Slider(100, range=0..100)))
X_4 = UnitX(Factor=expr("-x", Slider(100, range=0..100)))
mirror = Mirror(Geometry=merge_4, Plane=PlaneYZ(0, 0, 0))  # -> Geometry, Transform
X_5 = UnitX(Factor=expr("-x", Slider(100, range=0..100)))
mirror_2 = Mirror(Geometry=crv_5, Plane=PlaneYZ(0, 0, 0))  # -> Geometry, Transform
move_7 = Move(Geometry=mirror.Geometry, Motion=X_3)  # -> Geometry, Transform
move_8 = Move(Geometry=mirror_2.Geometry, Motion=X_4)  # -> Geometry, Transform
crv_10 = Curve(<curve referenced from the Rhino model>)
Z_4 = UnitZ(Factor=Slider(1, range=0..100))
number_slider_12 = Slider(10, range=0..100)
merge_5 = Merge(Data1=merge_4, Data2=move_7.Geometry)
crv_11 = Curve(<curve referenced from the Rhino model>)
move_9 = Move(Geometry=crv_10, Motion=Z_4)  # -> Geometry, Transform
number_slider_13 = Slider(21, range=0..100)
Z_5 = UnitZ(Factor=number_slider_12)
boundary_3 = BoundarySurfaces(Edges=crv_11)
Z_6 = UnitZ(Factor=expr("x+5", number_slider_12))
boundary_4 = BoundarySurfaces(Edges=move_9.Geometry)
extr_3 = Extrude(Base=boundary_3, Direction=Z_5)
extr_4 = Extrude(Base=boundary_4, Direction=Z_6)
sdiff_2 = SolidDifference(BrepsA=extr_3, BrepsB=extr_4)
mirror_3 = Mirror(Geometry=crv_11, Plane=PlaneYZ(0, 0, 0))  # -> Geometry, Transform
move_10 = Move(Geometry=mirror_3.Geometry, Motion=X_5)  # -> Geometry, Transform
